# Grasshopper definition create_run_data.ghx (Grasshopper 1.0.7)

txt = Text(["1GG-00-000", "1GG-00-001", "1GG-00-002", "1GG-00-003", "1GG-00-004", "1GG-00-005", "1GG-00-006", "1GG-00-007", "1GG-00-008", "1GG-00-009", "1GG-00-010", "1GG-00-011", "1GG-00-012", "1GG-00-013", "1GG-00-014", "1GG-00-015", "1GG-00-016", "1GG-00-017", "1GG-00-018", "1GG-00-019", "1GG-00-020", "1GG-00-021", "1GG-00-022", "1GG-00-023"])
pln = Plane([Plane(origin=(10291.35333, 29777.49637, 300.7808041), x=(-0.8661283919, 0.02296770403, -0.4992935943), y=(0.02639064369, 0.9996516854, 0.0002043251998)), Plane(origin=(10187.09589, 29782.87701, 300.8664473), x=(-0.8868983967, 0.06411303504, -0.457493992), y=(0.07201526641, 0.9974035159, 0.0001668704804)), Plane(origin=(10083.0706, 29791.69797, 300.9526793), x=(-0.905982493, 0.08515238976, -0.4146622635), y=(0.09350895714, 0.9956184273, 0.0001490617107)), Plane(origin=(9979.155385, 29801.76044, 301.0391024), x=(-0.9243369332, 0.08966056087, -0.3708938094), y=(0.09648845831, 0.9953340926, 0.0001465846942)), Plane(origin=(9875.192165, 29811.30713, 301.125448), x=(-0.9419293044, 0.07940867709, -0.3262873695), y=(0.08395228861, 0.996469763, 0.0001569929782)), Plane(origin=(9771.062553, 29818.78972, 301.2114623), x=(-0.9581610924, 0.0547501795, -0.2809443696), y=(0.05699544595, 0.9983744223, 0.0001792528426))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])

# ----
# Configuration
path = FilePath("C:\rcf_robotcontrol\01_confs\201104.yaml")
panel = Panel(path)

path_2 = FilePath("C:\rcf_robotcontrol\02_pick_frame_lists\201027-right-pick-conf_twotray.json")

path_3 = FilePath("C:\rcf_robotcontrol\03_run_data\")
path_4 = FilePath("C:\rcf_robotcontrol\04_logs\")

# ----
# Save file
save_json_file = Button()

# ---- group: 201112A
# TRANSFORMATION
transform = Transform({TransformCount=1, Name="Generic", m00=0.2677243596, m01=0.9634955444, m02=-5.684609899e-05, m03=-32218.8454, m10=-0.9634954698, m11=0.2677243614, m12=0.0003820204541, m13=5935.116163, m20=0.000383294091, m21=-4.750522258e-05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})

# ----
bang = Button()
points = PointList(Points=pln, Size=Slider(20, range=0..100))

# ----
# Pick frame list
panel_2 = Panel(path_2)

# ----
# Save directory
panel_3 = Panel(path_3)

# ----
# Folder for log files
panel_4 = Panel(path_4)

unload = PythonScript(bang=bang, module="rapid_clay_formations_fab")
# ---------- unload: Python ----------
import sys

def unload_modules(top_level_module_name):
    """Unloads all modules named starting with the specified string.

    This function eases the development workflow when editing a library that is
    used from Rhino/Grasshopper.

    Args:
        top_level_module_name (:obj:`str`): Name of the top-level module to unload.

    Returns:
        list: List of unloaded module names.
    """
    modules = filter(lambda m: m.startswith(top_level_module_name), sys.modules)

    for module in modules:
        sys.modules.pop(module)

    return modules

unload_modules(module)
# ---------- end unload ----------
paths = GhPythonScript(planes=flatten(pln), ids=txt)  # -> out, split_planes, split_compression_list, split_ids, file_name; inputs start: Int32, end: Int32, planes: list of Plane, compression: list, ids: list
# ---------- paths: Python ----------
import math

if not start:
    start = 0
if not end:
    end = len(planes)

if not len(compression):
    standard_value = 1 - .63
    split_compression_list = [standard_value] * (end - start)
else:
    split_compression_list = [1 - c for c in compression[start:end]]
split_planes = planes[start:end]
split_ids = ids[start:end]

level_segment = ids[0].split("-")[0]
file_name = "{}-{:03d}-{:03d}".format(level_segment, start, end)

print("{} cylinders".format(len(split_planes)))

density = 2087
r = 0.045
h = 0.15

volume_sqm = math.pi * (r ** 2) * h
weight_kg = volume_sqm * density

print("Total volume: {:.3f} sqm".format(volume_sqm * len(split_planes)))
print("Total weight: {:.3f} kg".format(weight_kg * len(split_planes)))

avg_cycle_time = 40

expected_run_duration_s = avg_cycle_time * len(split_planes)
expected_run_duration_min = expected_run_duration_s / 60
expected_run_duration_hrs = expected_run_duration_min // 60
expected_run_duration_remaining_min = expected_run_duration_min % 60

print("Expected run duration: {:.0f} hours and {:.0f} minutes.".format(
                                                               expected_run_duration_hrs,
                                                               expected_run_duration_remaining_min))
# ---------- end paths ----------
panel_5 = Panel(paths.out)
panel_6 = Panel(paths.file_name)
file = ReadFile(File=path, PerLineParse=False)
panel_7 = Panel(file)

# ----
# Planes
pln_2 = Plane(paths.split_planes)

# ----
# Compression
# (old format
# (0-1, larger number = less compression))
num = Number(paths.split_compression_list)

# ----
# IDs
txt_2 = Text(paths.split_ids)

# ---- group: Transformation WCS to RCS
transform_2 = Transform(transform)

# ----
transform_3 = Transform(Geometry=pln_2, Transform=transform_2)  # -> flatten(Geometry)

# ----
# Red (x) pointing inward please!
number_slider = Slider(-90, range=-360..360)
prot = RotatePlane(Plane=transform_3, Angle=degrees(number_slider))

egress_distance = Slider(150, range=0..1000)

# ----
# PlaceElement creation
number_slider_2 = Slider(45, range=0..100)
number_slider_3 = Slider(150, range=0..200)
pln_3 = Plane(prot)
create_placeelement_objects = GhPythonScript(
    planes=pln_3,
    radius=number_slider_2,
    height=number_slider_3,
    compression=num,
    id=txt_2,
    egress_frame_distance=egress_distance,
    create_meshes=Toggle(True),
    u_res=Slider(25, range=0..25))  # -> out, elements, planes, meshes, egress_planes; inputs planes: list of Plane, compression: list, id: list, egress_frame_distance: list of Int32, create_meshes: Boolean, u_res: Int32
# ---------- create_placeelement_objects: Python ----------
import Rhino.Geometry as rg
import ghpythonlib

from rapid_clay_formations_fab.utils import wrap_list
from rapid_clay_formations_fab.utils import ensure_frame
from rapid_clay_formations_fab.fab_data import PlaceElement
from rapid_clay_formations_fab.rhino import cgframe_to_rgplane

def generate_mesh(cls):
    return cls.get_rgmesh(u_res=u_res)

if len(planes) != len(id) and len(id) != 0:
    raise Exception("Different amount of planes and ids")

elements = []
for i, plane in enumerate(planes):

    kwargs = {}

    # Following keyword arguments are assumed to be one per element

    kwargs['radius'] = radius

    kwargs['height'] = height
    kwargs['compression_ratio'] = compression[i]

    if len(egress_frame_distance) > 0:
        kwargs['egress_frame_distance'] = wrap_list(egress_frame_distance, i)

    elements.append(PlaceElement(ensure_frame(plane), id[i], **kwargs))

location_frames = [elem.location for elem in elements]
location_planes = [elem.get_location_rgplane() for elem in elements]

egress_frames = [elem.get_egress_frame() for elem in elements]
egress_planes = [cgframe_to_rgplane(frame) for frame in egress_frames]

if create_meshes:
    # normal
    meshes = [elem.get_rgmesh(u_res=u_res) for elem in elements]


    # parallel (quicker)
    #meshes = ghpythonlib.parallel.run(generate_mesh, elements, flatten_results=True)
# ---------- end create_placeelement_objects ----------

# ----
# PickStation
number_slider_4 = Slider(225, range=0..1000)
python = GhPythonScript(
    pick_frames_path=path_2,
    elem_height=number_slider_3,
    elem_egress_distance=number_slider_4,
    station_egress_distance=Slider(400, range=0..1000),
    rotation=Slider(90, range=-360..360))  # -> out, pick_station, pick_planes
# ---------- python: Python ----------
import json
import math

from compas.geometry import Frame
from compas.geometry import Rotation
from compas.utilities import DataDecoder

from rapid_clay_formations_fab.robots import PickStation
from rapid_clay_formations_fab.rhino import cgframe_to_rgplane


with open(pick_frames_path, mode="r") as fp:
     pick_frames = json.load(fp, cls=DataDecoder)

if rotation:
    for f in pick_frames:
        R = Rotation.from_axis_and_angle(f.zaxis, math.radians(rotation), f.point)
        f.transform(R)
pick_station = PickStation(pick_frames,
                            elem_height=elem_height,
                            elem_egress_distance=elem_egress_distance,
                            station_egress_distance=station_egress_distance)

pick_planes = [cgframe_to_rgplane(f) for f in pick_frames]
# ---------- end python ----------

pln_4 = Plane(create_placeelement_objects.planes)
pln_5 = Plane(create_placeelement_objects.egress_planes)

# ---- group: Clay bullet visualization
# PlaceElement meshes
mesh = Mesh(create_placeelement_objects.meshes)

# ----
# Preview planes (Z should b down)
number_slider_5 = Slider(1, range=0..10)
cluster = Cluster(plane=flatten(pln_3), amplitude=Slider(51, range=0..100), R=number_slider_5)  # -> geo, color
preview = CustomPreview(Geometry=cluster.geo, Material=cluster.color)

python_2 = GhPythonScript(
    fab_data=simplify(create_placeelement_objects.elements),
    xform=transform_2,
    conf_path=path,
    pick_station=python.pick_station,
    log_dir=path_4,
    save_dir=path_3,
    name=panel_6,
    save=save_json_file)  # -> out; inputs fab_data: list, xform: Transform, save: Boolean
# ---------- python_2: Python ----------
import json
import os
import datetime
import time

import System
import Rhino.Geometry as rg

from compas.utilities import DataEncoder
from rapid_clay_formations_fab.rhino import rgtransform_to_matrix
from rapid_clay_formations_fab.rhino import rgplane_to_cgframe
from rapid_clay_formations_fab import __version__

if fab_data is None:
    raise Exception("No fab_data specified.")

run_data = {}

run_data["fab_data"] = fab_data
run_data["conf_path"] = conf_path
run_data["pick_station"] = pick_station

run_data["log_dir"] = log_dir

datetime_now = datetime.datetime.now()
iso_timestamp = datetime_now.isoformat()

run_data["created"] = iso_timestamp

run_data["hostname"] = System.Net.Dns.GetHostName()
run_data["rcf_fab_version"] = __version__

run_data["xform"] = rgtransform_to_matrix(xform)

plane = rg.Plane.WorldXY.Clone()
plane.Transform(xform)

run_data["rcf"] = rgplane_to_cgframe(plane)

if save:
    # file name can not contain comma and microseconds are overkill
    file_timestamp = datetime_now.strftime('%Y%m%dT%H.%M.%S')

    file_name = file_timestamp + "-" + name + ".json"
    full_path = os.path.join(save_dir, file_name)
    with open(full_path, mode='w') as fp:
        json.dump(run_data, fp, cls=DataEncoder)
# ---------- end python_2 ----------

# ==== cluster Cluster
plane = ClusterInput()
amplitude = ClusterInput()
R = ClusterInput()
deconstruct_plane = DeconstructPlane(Plane=graft(plane))  # -> Origin, XAxis, YAxis, ZAxis
amplitude_2 = Amplitude(Vector=deconstruct_plane.XAxis, Amplitude=amplitude)
amplitude_3 = Amplitude(Vector=deconstruct_plane.YAxis, Amplitude=amplitude)
amplitude_4 = Amplitude(Vector=deconstruct_plane.ZAxis, Amplitude=amplitude)
move = Move(Geometry=deconstruct_plane.Origin, Motion=amplitude_3)  # -> Geometry, Transform
move_2 = Move(Geometry=deconstruct_plane.Origin, Motion=amplitude_4)  # -> Geometry, Transform
move_3 = Move(Geometry=deconstruct_plane.Origin, Motion=amplitude_2)  # -> Geometry, Transform
ln = Line(StartPoint=deconstruct_plane.Origin, EndPoint=move.Geometry)
ln_2 = Line(StartPoint=deconstruct_plane.Origin, EndPoint=move_3.Geometry)
ln_3 = Line(StartPoint=deconstruct_plane.Origin, EndPoint=move_2.Geometry)
pipe = Pipe(Curve=ln, Radius=R, Caps=0)  # -> simplify(Pipe)
pipe_2 = Pipe(Curve=ln_2, Radius=R, Caps=0)  # -> simplify(Pipe)
pipe_3 = Pipe(Curve=ln_3, Radius=R, Caps=0)  # -> simplify(Pipe)
path_mapper = PathMapper(pipe_2, source="{*}", target="{0}")
path_mapper_2 = PathMapper(ColourSwatch(SwatchColor=RGB(255, 0, 0)), source="{*}", target="{0}")
path_mapper_3 = PathMapper(pipe, source="{*}", target="{1}")
path_mapper_4 = PathMapper(ColourSwatch(SwatchColor=RGB(0, 255, 0)), source="{*}", target="{1}")
path_mapper_5 = PathMapper(ColourSwatch(SwatchColor=RGB(0, 0, 255)), source="{*}", target="{2}")
path_mapper_6 = PathMapper(pipe_3, source="{*}", target="{2}")
data = Data([path_mapper_6, path_mapper_3, path_mapper])
data_2 = Data([path_mapper_5, path_mapper_4, path_mapper_2])
geo = ClusterOutput(data)
color = ClusterOutput(data_2)
